# Grasshopper definition inflation.gh (Grasshopper 1.0.7)
# plug-ins: Bifocals, Starling, Kangaroo2 Components, MeshEdit Components

# ---- group: BREP
brep = Brep([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])

# ----
slfastmesh = SlFastMesh(BReps=brep, EdgeLength=Slider(1, range=0..10))
custom_preview = CustomPreview(Geometry=brep, Material=ColourSwatch(SwatchColor=RGB(246, 0, 97)))
mesh_edges = MeshEdges(Mesh=slfastmesh)  # -> NakedEdges, InteriorEdges, NonManifoldEdges
end_points = EndPoints(Curve=mesh_edges.NakedEdges)  # -> Start, End
rod = Rod(
    Polyline=mesh_edges.NakedEdges,
    LengthFactor=1,
    AngleFactor=Slider(1, range=0..1),
    AxialStrength=10,
    BendStrength=Slider(311, range=0..1000))
boolean_toggle = BooleanToggle(False)
button = Button()
livesoap = LiveSoap(
    Mesh=slfastmesh,
    UseVolume=Toggle(True),
    VolumeChange=Slider(-1000, range=-1000..1000),
    Strength=Slider(10, range=0..10),
    Reset=button)
plasticanchor = PlasticAnchor(
    Point=[end_points.Start, end_points.End],
    Limit=Slider(4.527, range=0..20),
    Strength=Slider(1000, range=0..1000),
    Reset=button)
number_slider = Slider(0.129, range=0..1)
merge = Merge(Data1=rod, Data2=plasticanchor, Data3=livesoap)  # -> flatten(Result)
number_slider_2 = Slider(1, range=0..10)
zombiesolver = ZombieSolver(GoalObjects=merge, Threshold=1e-10, Tolerance=0.01, MaxIterations=Slider(0, range=0..100))  # -> I, V, O
list_item = ListItem(List=zombiesolver.O, Index=0, Wrap=True)
mesh_volume = MeshVolume(Mesh=list_item)  # -> Volume, Centroid
scale = Scale(Geometry=list_item, Center=mesh_volume.Centroid, Factor=Slider(1.424, range=0..10))  # -> Geometry, Transform
construct_plane = ConstructPlane(Origin=mesh_volume.Centroid, XAxis=Vector(1, 0, 0), YAxis=Vector(0, 1, 0))
scale_nu = ScaleNU(Geometry=scale.Geometry, Plane=construct_plane, ScaleX=1, ScaleY=Slider(1.287, range=0..2), ScaleZ=1)  # -> Geometry, Transform
xy_plane = XYPlane(Origin=Point(0, 0, 0))
mesh_edges_2 = MeshEdges(Mesh=scale_nu.Geometry)  # -> NakedEdges, InteriorEdges, NonManifoldEdges
create_material = CreateMaterial(
    Diffuse=ColourSwatch(SwatchColor=RGB(163, 255, 218)),
    Specular=RGB(255, 255, 255),
    Emission=RGB(0, 0, 0),
    Transparency=Slider(0.7, range=0..1),
    Shine=0)
custom_preview_2 = CustomPreview(Geometry=scale_nu.Geometry, Material=create_material)
